# Grasshopper definition Estudando o edifício orgânico.gh (Grasshopper 0.9.76)

ponto_de_toque_nordeste = Point(<point referenced from the Rhino model>)
ponto_de_toque_central = Point(<point referenced from the Rhino model>)
ponto_de_toque_oeste = Point(<point referenced from the Rhino model>)
numero_de_segmentos = Slider(23, range=0..100, expression="x*2")
Z = UnitZ(Factor=1)
cat = Catenary(PointA=ponto_de_toque_nordeste, PointB=ponto_de_toque_central, Length=Slider(67.4, range=0..100), Gravity=Z)
cat_2 = Catenary(PointA=ponto_de_toque_central, PointB=ponto_de_toque_oeste, Length=Slider(61.32, range=0..100), Gravity=Z)
cat_3 = Catenary(PointA=ponto_de_toque_oeste, PointB=ponto_de_toque_nordeste, Length=Slider(141, range=0..1000), Gravity=Z)

# ---- group: Tamanho médio do elemento
len = Length(Curve=cat_3)
division = Division(A=len, B=numero_de_segmentos)
panel = Panel(division)

# ----
expression = Expression(x=numero_de_segmentos, Expression="x/2")
expression_2 = Expression(x=numero_de_segmentos, Expression="x/2")

# ---- group: Arco sudeste
arco_sudeste = DivideCurve(Curve=cat, Count=expression, Kinks=False)  # -> Points, Tangents, Parameters

# ---- group: Arco Sul
divide = DivideCurve(Curve=cat_2, Count=expression_2, Kinks=False)  # -> Points, Tangents, Parameters

# ---- group: Arco Noroeste
divide_2 = DivideCurve(Curve=cat_3, Count=numero_de_segmentos, Kinks=False)  # -> Points, Tangents, Parameters

# ----
end = EndPoints(Curve=cat_3)  # -> Start, End
dom = ConstructDomain(DomainStart=1, DomainEnd=expr("x-1", numero_de_segmentos))
sunion = SetUnion(SetA=divide.Points, SetB=arco_sudeste.Points)
subset = SubList(List=sunion, Domain=dom, Wrap=True)  # -> List, Index
exdiff = SetDifferenceS(SetA=divide_2.Points, SetB=[end.Start, end.End])
dist = Distance(PointA=subset.List, PointB=exdiff)
multiplication = Multiplication(A=dist, B=Slider(1.2, range=0..10))
Z_2 = UnitZ(Factor=1)
cat_4 = Catenary(PointA=subset.List, PointB=exdiff, Length=multiplication, Gravity=Z_2)
len_2 = Length(Curve=cat_4)
division_2 = Division(A=len_2, B=panel)
int = Integer(division_2)
divide_3 = DivideCurve(Curve=cat_4, Count=int, Kinks=False)  # -> simplify(flatten(Points)), Tangents, Parameters
del = DelaunayMesh(Points=divide_3.Points, Plane=PlaneXY(0, 0, 0))
