# Grasshopper definition Estudo sobre curva base gerando edifício orgânico.gh (Grasshopper 0.9.76)
# plug-ins: Weaverbird

crv = Curve(<curve referenced from the Rhino model>)
pt = Point([<point referenced from the Rhino model> x3])
number_slider = Slider(20, range=0..100)
patch = Patch(Curves=crv, Points=pt, Spans=20, Flexibility=1, Trim=True)
Z = UnitZ(Factor=Slider(100, range=0..100))
divide = DivideDomain²(Domain=patch, UCount=number_slider, VCount=number_slider)
subsrf = Isotrim(Surface=patch, Domain=divide)
srfpt = SurfacePoints(Surface=subsrf)  # -> Points, Weights, Greville, UCount, VCount
mesh = Mesh(subsrf)
popgeo = PopulateGeometry(Geometry=patch, Count=100, Seed=1)
popgeo_2 = PopulateGeometry(Geometry=patch, Count=100, Seed=1)
extr = Extrude(Base=crv, Direction=Z)
del = DelaunayMesh(Points=popgeo, Plane=PlaneXY(0, 0, 0))
wbtriangles = WeaverbirdsSplitTrianglesSubdivision(MeshCurves=del, Level=1)
