# Grasshopper definition acesso pela domingos.gh (Grasshopper 0.9.76)
# plug-ins: GhVa10

number_slider = Slider(2.5, range=0..10)
ponto_de_partida = Point(<point referenced from the Rhino model>)
number_slider_2 = Slider(0.4, range=0..1)
panel = Panel("""-20
-40
-60""")
X = UnitX(Factor=panel)
division = Division(A=1, B=Slider(0.175, range=0..1))
int = Integer(division)
multiplication = Multiplication(A=number_slider_2, B=int)
Y = UnitY(Factor=multiplication)
line = LineSDL(Start=ponto_de_partida, Direction=Y, Length=multiplication)
move = Move(Geometry=line, Motion=X)  # -> graft(Geometry), Transform
addition = Addition(A=multiplication, B=2.5)
series = Series(Start=1, Step=1, Count=3)
series_2 = Series(Start=addition, Step=addition, Count=3)
stairopt = StairOption(
    Style={RefHandle=0, RefName=""},
    Align=1,
    Height=1,
    Width=number_slider,
    StepCount=int,
    Tread=number_slider_2,
    StartThickness=0,
    EndThickness=0)
vec = VectorXYZ(XComponent=0, YComponent=series_2, ZComponent=series)  # -> flatten(Vector), Length
move_2 = Move(Geometry=move.Geometry, Motion=vec.Vector)  # -> Geometry, Transform
stair = Stair(ShapeCurve=[move.Geometry, move_2.Geometry], Option=stairopt)
end = EndPoints(Curve=[move.Geometry, move_2.Geometry])  # -> Start, End
Y_2 = UnitY(Factor=1)
Z = UnitZ(Factor=1)
split = SplitList(List=end.End, Index=3)  # -> ListA, ListB
move_3 = Move(Geometry=split.ListA, Motion=Z)  # -> Geometry, Transform
line_2 = LineSDL(Start=move_3.Geometry, Direction=Y_2, Length=2.5)  # -> simplify(Line)
X_2 = UnitX(Factor=expr("x/2", number_slider))
neg = Negative(Value=X_2)
extr = Extrude(Base=graft(line_2), Direction=[X_2, neg])
panel_2 = Panel("""{2;0}
{1;1}
{0;2}""")
join = BrepJoin(Breps=extr)  # -> Breps, Closed
split_2 = SplitTree(Data=join.Breps, Masks=flatten(panel_2))  # -> Positive, Negative
box_corners = BoxCorners(Box=split_2.Positive)  # -> CornerA, CornerB, CornerC, CornerD, CornerE, CornerF, CornerG, CornerH
pt = Point(<point referenced from the Rhino model>)
pt_2 = Point(<point referenced from the Rhino model>)
pt_3 = Point(flatten([pt_2, box_corners.CornerC]))
pt_4 = Point(flatten([pt, box_corners.CornerD]))
sort_pt = SortPoints(Points=pt_3)  # -> Points, Indices
rev = ReverseList(List=sort_pt.Points)
ln = Line(StartPoint=pt_4, EndPoint=rev)
Y_3 = UnitY(Factor=number_slider)
neg_2 = Negative(Value=Y_3)
extr_2 = Extrude(Base=ln, Direction=neg_2)
slab = Slab(Curve=extr_2, Option=null)
