# Grasshopper definition caixa de elevadores e escada enclausurada.gh (Grasshopper 0.9.76)
# plug-ins: GhVa10

quantidade_de_elevadores_por_lado = Slider(2, range=0..10)
quantidade_de_pavimentos = Slider(12, range=0..100)
pé_direito = Slider(2.5, range=0..10)
rec = Rectangle({Plane=PlaneXY(960.9127591, -527.3506576, 796), Size=Domain2(u=0..5.000013814, v=0..9.999986186)})
iprofile = IProfile(
    Name="New I profile",
    Depth=0.6,
    Width=0.215,
    WebThickness=0.02,
    FlangeThickness=0.03,
    FilletRadius=0,
    FlangeEdgeRadius=0,
    FlangeSlopeAngle=0)
series = Series(Start=pé_direito, Step=pé_direito, Count=quantidade_de_pavimentos)
multiplication = Multiplication(A=pé_direito, B=quantidade_de_pavimentos)
explode = Explode(Curve=rec, Recursive=True)  # -> Segments, Vertices
columnsty = ColumnStyle(Name="New column style", Profile=iprofile, Sizes={RefHandle=0, RefName=""}, Height=multiplication)
box_corners = BoxCorners(Box=rec)  # -> CornerA, CornerB, CornerC, CornerD, CornerE, CornerF, CornerG, CornerH
panel = Panel("""1
3""")
Z = UnitZ(Factor=series)
columnopt = ColumnOption(Style=columnsty, Profile={RefHandle=0, RefName=""}, Align=4, Rotation=0, Height=0)
move = Move(Geometry=rec, Motion=Z)  # -> Geometry, Transform
item = ListItem(List=explode.Segments, Index=panel, Wrap=True)
curvepoint = PointOnCurve(item, parameter=0.5)
slabopt = SlabOption(Style={RefHandle=0, RefName=""}, Align=0, Thickness=".20")
slab = Slab(Curve=move.Geometry, Option=slabopt)
column = Column(
    Position=[box_corners.CornerA, box_corners.CornerB, box_corners.CornerC, box_corners.CornerD, curvepoint],
    Option=columnopt)
explode_2 = Explode(Curve=move.Geometry, Recursive=True)  # -> Segments, Vertices
panel_2 = Panel("""1
3""")
panel_3 = Panel("""0
2""")
item_2 = ListItem(List=explode_2.Segments, Index=panel_2, Wrap=True)
item_3 = ListItem(List=explode_2.Segments, Index=panel_3, Wrap=True)
curvepoint_2 = PointOnCurve(item_2, parameter=0.5)
offset = Offset(Curve=item_3, Distance=Slider(2.5, range=0..10), Plane=PlaneXY(0, 0, 0), Corners=1)
scale_nu = ScaleNU(Geometry=item_2, Plane=curvepoint_2, ScaleX=1, ScaleY=Slider(1.5, range=0..10), ScaleZ=1)  # -> Geometry, Transform
iprofile_2 = IProfile(
    Name="New I profile",
    Depth=0.3,
    Width=0.215,
    WebThickness=0.02,
    FlangeThickness=0.03,
    FilletRadius=0,
    FlangeEdgeRadius=0,
    FlangeSlopeAngle=0)
beamsty = BeamStyle(Name="New beam style", Profile=iprofile_2, Sizes={RefHandle=0, RefName=""})
beam = Beam(Curve=offset, Option=null)
beam_2 = Beam(Curve=item_3, Option=null)
beamopt = BeamOption(Style=beamsty, Profile={RefHandle=0, RefName=""}, Align=4)
beam_3 = Beam(Curve=scale_nu.Geometry, Option=beamopt)
