# Grasshopper definition escadas de incendio.gh (Grasshopper 0.9.76)
# plug-ins: GhVa10

pt = Point(<point referenced from the Rhino model>)
pavimentos = Slider(4, range=0..10)
number_slider = Slider(5, range=0..10)
number_slider_2 = Slider(0.32, range=0..1)
series = Series(Start=0, Step=number_slider, Count=pavimentos)
Z = UnitZ(Factor=series)
stairslab = StairSlab(Name="Slab", Thickness=0.15)
division = Division(A=number_slider, B=Slider(0.165, range=0..1))
move = Move(Geometry=pt, Motion=Z)  # -> Geometry, Transform
int = Integer(division)
stairsty = StairStyle(
    Name="New stair style",
    Components=stairslab,
    Balanced=True,
    Radius=0.2,
    DrawTread=False,
    TreadThickness=0.03,
    TreadNosing=0.05,
    DrawRiser=False,
    RiserThickness=0.03)
crv = Curve(<curve referenced from the Rhino model>)
wallopt = WallOption(Style={RefHandle=0, RefName=""}, Align=2, Offset=0, Height=Slider(20, range=0..100))
multiplication = Multiplication(A=int, B=number_slider_2)
Y = UnitY(Factor=1)
rectprof = RectangularProfile(Name="New rectangular profile", Width=1.1, Height=2.2)
stairopt = StairOption(
    Style=stairsty,
    Align=0,
    Height=expr("x/2", number_slider),
    Width=expr("x/2", number_slider),
    StepCount=expr("x/2", int),
    Tread=number_slider_2,
    StartThickness=0,
    EndThickness=0)
wall = Wall(Curve=crv, Option=wallopt)
dooropt = DoorOption(
    Style={RefHandle=0, RefName=""},
    Profile=rectprof,
    VerticalAlignment=0,
    HorizontalAlignment=1,
    InsertionAlignment=1,
    OpeningSide=0,
    Aperture=0,
    Elevation=0)
line = LineSDL(Start=move.Geometry, Direction=Y, Length=multiplication)
pt_2 = Point(<point referenced from the Rhino model>)
curvepoint = PointOnCurve(line, parameter=0.5)
divide = DivideCurve(Curve=line, Count=2, Kinks=False)  # -> Points, Tangents, Parameters
door = Door(Wall=wall, Position=pt_2, Option=dooropt)
series_2 = Series(Start=0, Step=number_slider, Count=pavimentos)
shatter = Shatter(Curve=line, Parameters=divide.Parameters)
Z_2 = UnitZ(Factor=series_2)
item = ListItem(List=shatter, Index=1, Wrap=True)
item_2 = ListItem(List=shatter, Index=0, Wrap=True)
pt_3 = Point(curvepoint)
pt_4 = Point(move.Geometry)
move_2 = Move(Geometry=door, Motion=Z_2)  # -> Geometry, Transform
vec = VectorXYZ(XComponent=0, YComponent=-0.2, ZComponent=2.5)  # -> Vector, Length
vec_2 = VectorXYZ(XComponent=0, YComponent=0.2, ZComponent=0)  # -> Vector, Length
move_3 = Move(Geometry=pt_3, Motion=vec.Vector)  # -> Geometry, Transform
move_4 = Move(Geometry=pt_4, Motion=vec_2.Vector)  # -> Geometry, Transform
Y_2 = UnitY(Factor=expr("x/2", number_slider))
rotate = Rotate(Geometry=item, Angle=-3.141592654, Plane=curvepoint)  # -> Geometry, Transform
vec_3 = VectorXYZ(XComponent=expr("0", number_slider), YComponent=0, ZComponent=expr("x/2", number_slider))  # -> Vector, Length
Y_3 = UnitY(Factor=expr("(x/2)*-1", number_slider))
move_5 = Move(Geometry=rotate.Geometry, Motion=vec_3.Vector)  # -> Geometry, Transform
dup = DuplicateData(Data=Y_2, Number=pavimentos, Order=True)
dup_2 = DuplicateData(Data=Y_3, Number=pavimentos, Order=True)
merge = Merge(Data1=item_2, Data2=move_5.Geometry)
line_2 = LineSDL(Start=[move_3.Geometry, move_4.Geometry], Direction=[dup, dup_2], Length=expr("x/2", number_slider))
X = UnitX(Factor=expr("x/2", number_slider))
X_2 = UnitX(Factor=expr("(x/2)*-1", number_slider))
stair = Stair(ShapeCurve=merge, Option=stairopt)
extr = Extrude(Base=line_2, Direction=X)
extr_2 = Extrude(Base=line_2, Direction=X_2)
slab = Slab(Curve=[extr, extr_2], Option=null)
