# Grasshopper definition pavimentos do edifício organico.gh (Grasshopper 0.9.76)
# plug-ins: GhVa10

numero_de_pavimentos = Slider(5, range=0..10)
number_slider = Slider(5, range=0..10)
crv = Curve(<curve referenced from the Rhino model>)
srf = Surface(<surface referenced from the Rhino model>)
rec = Rectangle({Plane=PlaneXY(958.3999637, -527.3506576, 796), Size=Domain2(u=0..2.522795495, v=0..2.999972407)})
crv_2 = Curve(<curve referenced from the Rhino model>)
srf_2 = Surface(<surface referenced from the Rhino model>)
series = Series(Start=0, Step=number_slider, Count=numero_de_pavimentos)
series_2 = Series(Start=0, Step=number_slider, Count=numero_de_pavimentos)
Z = UnitZ(Factor=series)
Z_2 = UnitZ(Factor=series_2)
srf_3 = Surface(rec)
move = Move(Geometry=crv, Motion=Z_2)  # -> Geometry, Transform
move_2 = Move(Geometry=crv_2, Motion=Z)  # -> Geometry, Transform
dup = DuplicateData(Data=number_slider, Number=numero_de_pavimentos, Order=True)
multiplication = Multiplication(A=dup, B=-1)
end = EndPoints(Curve=[move.Geometry, move_2.Geometry])  # -> Start, End
Z_3 = UnitZ(Factor=expr("x/2", [dup, multiplication]))
series_3 = Series(Start=expr("x/2", number_slider), Step=expr("x/2", number_slider), Count=expr("x*2", numero_de_pavimentos))
series_4 = Series(Start=number_slider, Step=number_slider, Count=numero_de_pavimentos)
move_3 = Move(Geometry=end.End, Motion=Z_3)  # -> Geometry, Transform
ln = Line(StartPoint=end.Start, EndPoint=move_3.Geometry)
Z_4 = UnitZ(Factor=series_4)
Z_5 = UnitZ(Factor=series_3)
move_4 = Move(Geometry=srf, Motion=Z_4)  # -> Geometry, Transform
move_5 = Move(Geometry=srf_3, Motion=Z_5)  # -> Geometry, Transform
scx = SurfaceCurve(Surface=srf_2, Curve=ln)  # -> Curves, flatten(Points), UVPoints, Normals, Parameters, Tangents
dist = Distance(PointA=scx.Points, PointB=end.Start)
srf_4 = Surface(move_5.Geometry)
project = Project(Curve=srf_2, Brep=move_4.Geometry, Direction=Vector(0, 0, 1))  # -> flatten(Curve)
subtraction = Subtraction(A=dist, B="3.5")
eval = EvaluateLength(Curve=ln, Length=subtraction, Normalized=False)  # -> Point, Tangent, Parameter
srfsplit = SurfaceSplit(Surface=move_4.Geometry, Curves=project)
shatter = Shatter(Curve=graft(ln), Parameters=graft(eval.Parameter))
graft = GraftTree(Tree=eval.Point, IncludeEmptyLists=True, IncludeNullItems=True)
item = ListItem(List=srfsplit, Index=0, Wrap=True)
item_2 = ListItem(List=shatter, Index=1, Wrap=True)
item_3 = ListItem(List=shatter, Index=1, Wrap=True)
bbx = BrepBrep(BrepA=item, BrepB=srf_2)  # -> Curves, Points
graft_2 = GraftTree(Tree=item, IncludeEmptyLists=True, IncludeNullItems=True)
rotate = Rotate(Geometry=item_2, Angle=degrees(Slider(180, range=0..1000)), Plane=graft)  # -> Geometry, Transform
item_4 = ListItem(List=shatter, Index=0, Wrap=True)
end_2 = EndPoints(Curve=item_3)  # -> Start, End
panel = Panel("""2
2
1
1
1""")
srfsplit_2 = SurfaceSplit(Surface=graft_2, Curves=bbx.Curves)  # -> simplify(Fragments)
merge = Merge(Data1=rotate.Geometry, Data2=item_4)
vec2pt = Vector2Pt(PointA=end_2.Start, PointB=end_2.End, Unitize=False)  # -> Vector, Length
graft_3 = GraftTree(Tree=panel, IncludeEmptyLists=True, IncludeNullItems=True)  # -> simplify(Tree)
devec = DeconstructVector(Vector=vec2pt.Vector)  # -> XComponent, YComponent, ZComponent
number_slider_2 = Slider(2.5, range=0..10)
curvepoint = PointOnCurve(merge, parameter=0.5)
vec = VectorXYZ(XComponent=devec.XComponent, YComponent=devec.YComponent, ZComponent=0)  # -> Vector, Length
item_5 = ListItem(List=srfsplit_2, Index=graft_3, Wrap=True)
hframe = HorizontalFrame(Curve=merge, Parameter=curvepoint)
line = LineSDL(Start=end_2.Start, Direction=vec.Vector, Length=2.5)
curvepoint_2 = PointOnCurve(line, parameter=0.5)
deplane = DeconstructPlane(Plane=hframe)  # -> Origin, XAxis, YAxis, ZAxis
split = SplitTree(Data=deplane.YAxis, Masks=flatten("{0;0;(0 to 4);0}"))  # -> Positive, Negative
split_2 = SplitTree(Data=deplane.YAxis, Masks=flatten("{0;0;(5 to 9);0}"))  # -> Positive, Negative
amp = Amplitude(Vector=split_2.Positive, Amplitude=expr("-1*x", number_slider_2))
amp_2 = Amplitude(Vector=split.Positive, Amplitude=number_slider_2)
hframe_2 = HorizontalFrame(Curve=line, Parameter=curvepoint_2)
deplane_2 = DeconstructPlane(Plane=hframe_2)  # -> Origin, XAxis, YAxis, ZAxis
extr = Extrude(Base=merge, Direction=[amp_2, amp])
amp_3 = Amplitude(Vector=deplane_2.YAxis, Amplitude=expr("-1*x", number_slider_2))
amp_4 = Amplitude(Vector=deplane_2.YAxis, Amplitude=number_slider_2)
extr_2 = Extrude(Base=line, Direction=[amp_4, amp_3])
slab = Slab(Curve=[extr, item_5, srf_4, extr_2], Option=null)
